# Grasshopper definition Living Loop Generator.gh (Grasshopper 1.0.7)

# ----
# Settings
gap_count = Slider(4, range=2..20)
loop_count = Slider(20, range=3..100)
gap_size = Slider(4, range=0..10)

# ----
# Curve A
crv = Curve(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)

# ----
# Curve B
crv_2 = Curve(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)

subtraction = Subtraction(A=loop_count, B=1)
division = Division(A=1, B=subtraction)
num = Number(loop_count)
multiplication = Multiplication(A=gap_count, B=2)
series = Series(Start=0, Step=division, Count=num)

# ----
# Loop Distribution
graph = GraphMapper(
    series,
    x0=0,
    x1=1,
    y0=0,
    y1=1,
    container_name="Bezier",
    cpx=[0, 0.3298215866, 0.8253501058, 1],
    cpy=[0, 0.1620050073, 0.7085987329, 1])

tweencrv = TweenCurve(CurveA=crv, CurveB=crv_2, Factor=graph, BlendType=0)
series_2 = Series(Start=0, Step=1, Count=num)
divide = DivideCurve(Curve=tweencrv, Count=multiplication, Kinks=False)  # -> Points, Tangents, Parameters
eval = Evaluate(F="x%2=0", x=series_2)
num_2 = Number(graft(eval))
shift = ShiftList(List=divide.Points, Shift=num_2, Wrap=True)  # -> simplify(List)
neg = Negative(Value=gap_size)
graft = GraftTree(Tree=tweencrv, IncludeEmptyLists=True, IncludeNullItems=True)
dispatch = Dispatch(List=shift, DispatchPattern=[True, False])  # -> ListA, ListB
division_2 = Division(A=neg, B=2)
crv_cp = CurveClosestPoint(Point=dispatch.ListA, Curve=graft)  # -> Point, Parameter, Distance
shatter = Shatter(Curve=graft, Parameters=crv_cp.Parameter)
ext = ExtendCurve(Curve=shatter, Type=0, Start=division_2, End=division_2)
join = JoinCurves(Curves=ext, Preserve=False)

# ----
# Output
crv_3 = Curve(join)

preview = CustomPreview(Geometry=crv_3, Material=ColourSwatch(SwatchColor=RGB(0, 0, 0)))
